# Grasshopper definition hops_hui.gh (Grasshopper 1.0.7)
# plug-ins: Weaverbird, Hops

deconstruct_mesh = DeconstructMesh()  # -> Vertices, Faces, Colours, Normals; disabled
trigger = Trigger(Interval=-1000, TimerInterval=1000)  # disabled
deconstruct = Deconstruct(Point=deconstruct_mesh.Vertices)  # -> flatten(XComponent), flatten(YComponent), flatten(ZComponent); disabled
deconstruct_face = DeconstructFace(Face=deconstruct_mesh.Faces)  # -> flatten(CornerA), flatten(CornerB), flatten(CornerC), flatten(CornerD); disabled
local = Panel("http://localhost:5000/processVF")  # disabled

mesh = Mesh(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)
local_2 = Panel("http://localhost:5000/processMesh")
mine = Panel("http://127.0.0.1:5000/processMesh")
florian_s = Panel("http://10.68.74.6:5000/processMesh")
# Inputs
local_3 = Panel("http://localhost:5000/read_1_mesh")

# ---- group: Iterations
# Guided Projection Algorithm Settings
iter = Slider(5, range=5..20)

# ---- group: weight_fairness
fairness = Panel("0.01")
fairness_2 = Panel("0.005")
fairness_3 = Panel("0.0005")
number = Number(fairness_2)

# ---- group: weight_self-closeness
closness_2 = Panel("0")
number_2 = Number(closness_2)

# ---- group: eps
epsilon = Panel("0.001")
number_3 = Number(epsilon)

# ---- group: a1gnet2_2g+voss+asy_unitscale
mesh_2 = Mesh(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)

# ---- group: input quadmesh
mesh_3 = Mesh(mesh_2)

# ---- group: 1st or 2nd poly
number_slider = Slider(0, range=0..1)

# ----
panel = Panel("AGG")
panel_2 = Panel("GGA")

panel_3 = Panel("GAA")
panel_4 = Panel("AAG")

panel_5 = Panel("GGAA")

panel_6 = Panel("Anet")
panel_7 = Panel("AnetDiagnet")

panel_8 = Panel("Gnet")
panel_9 = Panel("GnetDiagnet")

local_4 = Panel("http://localhost:5000/arrayss")

# ---- group: 1st or 2nd poly
number_slider_2 = Slider(0, range=0..1)

# ----
a_net_diag = BooleanToggle(False)
a_net = BooleanToggle(False)

g_net_diag = BooleanToggle(False)
g_net = BooleanToggle(False)

number_slider_3 = Slider(10, range=0..10)

gga = BooleanToggle(False)
agg = BooleanToggle(False)

aag = BooleanToggle(False)
gaa = BooleanToggle(False)

aagg = BooleanToggle(False)
ggaa = BooleanToggle(True)

# ---- group: Optimize
trigger_2 = Trigger(Interval=-1000, TimerInterval=1000)

# ----
trigger_3 = Trigger(Interval=-1000, TimerInterval=1000)

# ---- group: web
panel_10 = Panel("AAGG")
restart = BooleanToggle(False)

# ----
# Process
hops = Hops(
    _Path=local_3,
    Mesh=mesh_3,
    Iteration=iter,
    Fairness=number,
    W2Closeness=number_2,
    Direction=number_slider,
    Web=panel_10,
    Restart=restart,
    CacheResultsInMemory=False,
    CacheSolveResults=False,
    RemoteDefinitionLocation="http://localhost:5000/read_1_mesh",
    RemoteSolveVersion=(0, 1, 0),
    ShowInput_Enabled=False,
    ShowInput_Path=True,
    SynchronousSolve=True)  # -> Mesh, Vertices, Normal

# ---- group: output quadmesh
# Outputs
mesh_4 = Mesh(hops.Mesh)

# ----
# Optimized mesh vertex-normals
weaverbird_s_mesh_edges = WeaverbirdsMeshEdges(MeshOrPolylines=mesh_4)
length = Length(Curve=weaverbird_s_mesh_edges)
# Visulization
average = Average(Input=length)
amplitude = Amplitude(Amplitude=average)
addition = Addition(B=amplitude)
line = Line(EndPoint=addition)

# ----
# checker vertices
local_5 = Panel("http://localhost:5000/checker_tianvertex")
trigger_4 = Trigger(Interval=-1000, TimerInterval=1000, Target=hops_2)
hops_2 = Hops(
    _Path=local_5,
    Mesh=mesh_4,
    CacheResultsInMemory=False,
    CacheSolveResults=False,
    RemoteDefinitionLocation="http://localhost:5000/checker_tianvertex",
    RemoteSolveVersion=(0, 1, 0),
    ShowInput_Enabled=False,
    ShowInput_Path=True,
    SynchronousSolve=True)  # -> P1, P2
point = Point(hops_2.P1)
point_2 = Point(hops_2.P2)

local_6 = Panel("http://localhost:5000/bezier_splinesss")
trigger_5 = Trigger(Interval=-1000, TimerInterval=1000, Target=hops_4)

# ----
# get 2 ctrl-polylines + 2 diag-polylines
local_7 = Panel("http://localhost:5000/polyline_4_directions")
trigger_6 = Trigger(Interval=-1000, TimerInterval=1000, Target=hops_3)
hops_3 = Hops(
    _Path=local_7,
    Mesh=mesh_4,
    CacheResultsInMemory=False,
    CacheSolveResults=False,
    RemoteDefinitionLocation="http://localhost:5000/polyline_4_directions",
    RemoteSolveVersion=(0, 1, 0),
    ShowInput_Enabled=False,
    ShowInput_Path=True,
    SynchronousSolve=True)  # -> Polyline1, Polyline2, Polyline3, Polyline4
line_2 = Line(hops_3.Polyline2)
line_3 = Line(hops_3.Polyline4)
line_4 = Line(hops_3.Polyline1)
line_5 = Line(hops_3.Polyline3)

# ---- group: weight_Bezier-Ctrl-Pts
panel_11 = Panel("0.005")
panel_12 = Panel("0.05")
number_4 = Number("0.01")

# ---- group: ith-poly
panel_13 = Panel("2")
panel_14 = Panel("3")
panel_15 = Panel("4")
integer = Integer("1")

# ----
checker_vertices = BooleanToggle(False)
hops_4 = Hops(
    _Path=local_6,
    Mesh=mesh_4,
    Web=panel_10,
    VN=hops.Normal,
    Ipoly=integer,
    Weight=number_4,
    Checker=checker_vertices,
    CacheResultsInMemory=False,
    CacheSolveResults=False,
    RemoteDefinitionLocation="http://localhost:5000/bezier_splinesss",
    RemoteSolveVersion=(0, 1, 0),
    ShowInput_Enabled=False,
    ShowInput_Path=True,
    SynchronousSolve=True)  # -> CtrlP, Indices, An, E1, E2, E3, R

# ----
# reshape a list
list_length = ListLength(List=hops_4.Indices)
list_item = ListItem(List=hops_4.Indices, Index=0, Wrap=True)
multiplication = Multiplication(A=list_item, B=list_length)
series = Series(Start=0, Step=1, Count=multiplication)
partition_list = PartitionList(List=series, Size=list_item)  # -> simplify(Chunks)

panel_16 = Panel(hops_4.Indices)
vector = Vector()
point_3 = Point()
vector_2 = Vector()
point_4 = Point(hops_4.CtrlP)
vector_3 = Vector()
series_2 = Series(Start=0, Step=1, Count=Slider(6, range=0..10))
vector_4 = Vector()
list_item_2 = ListItem(List=point_4, Index=series_2, Wrap=True)

# ----
# unit principal normal E2
amplitude_2 = Amplitude(Vector=vector, Amplitude=average)
addition_2 = Addition(A=point_3, B=amplitude_2)
line_6 = Line(EndPoint=addition_2)

# ----
# unit tangent E1
amplitude_3 = Amplitude(Vector=vector_3, Amplitude=average)
addition_3 = Addition(A=point_3, B=amplitude_3)
line_7 = Line(EndPoint=addition_3)

panel_17 = Panel(point_4)

# ----
# unit Darboux(ruling) r
amplitude_4 = Amplitude(Vector=vector_4, Amplitude=average)
addition_4 = Addition(A=point_3, B=amplitude_4)
line_8 = Line(EndPoint=addition_4)

# ----
# unit binormal E3
amplitude_5 = Amplitude(Vector=vector_2, Amplitude=average)
addition_5 = Addition(A=point_3, B=amplitude_5)
line_9 = Line(EndPoint=addition_5)

list_item_3 = ListItem(List=point_4, Index=partition_list, Wrap=True)
number_slider_4 = Slider(1, range=0..1)
list_item_4 = ListItem(List=point_4, Index=Slider(2488, range=0..2488), Wrap=True)
# control_points + Bezier_splines
control_points = Point(list_item_3)
nurbs_curve = NurbsCurve(Vertices=list_item_2, Degree="5", Periodic=False)  # -> Curve, Length, Domain
nurbs_curve_2 = NurbsCurve(Vertices=control_points, Degree="5", Periodic=False)  # -> Curve, Length, Domain

local_8 = Panel("http://localhost:5000/lines")
panel_18 = Panel("""0.5
1
1.5""")
line_10 = Line(Line((-1, 0, 0), (-1, 3, 0)))

hops_5 = Hops(
    CacheResultsInMemory=False,
    CacheSolveResults=False,
    RemoteSolveVersion=(0, 1, 0),
    ShowInput_Enabled=False,
    ShowInput_Path=True,
    SynchronousSolve=True)
hops_6 = Hops(
    CacheResultsInMemory=False,
    CacheSolveResults=False,
    RemoteSolveVersion=(0, 1, 0),
    ShowInput_Enabled=False,
    ShowInput_Path=True,
    SynchronousSolve=True)
hops_7 = Hops(
    CacheResultsInMemory=False,
    CacheSolveResults=False,
    RemoteSolveVersion=(0, 1, 0),
    ShowInput_Enabled=False,
    ShowInput_Path=True,
    SynchronousSolve=True)
hops_8 = Hops(
    CacheResultsInMemory=False,
    CacheSolveResults=False,
    RemoteSolveVersion=(0, 1, 0),
    ShowInput_Enabled=False,
    ShowInput_Path=True,
    SynchronousSolve=True)
hops_9 = Hops(
    CacheResultsInMemory=False,
    CacheSolveResults=False,
    RemoteSolveVersion=(0, 1, 0),
    ShowInput_Enabled=False,
    ShowInput_Path=True,
    SynchronousSolve=True)
hops_10 = Hops(
    CacheResultsInMemory=False,
    CacheSolveResults=False,
    RemoteSolveVersion=(0, 1, 0),
    ShowInput_Enabled=False,
    ShowInput_Path=True,
    SynchronousSolve=True)
hops_11 = Hops(
    CacheResultsInMemory=False,
    CacheSolveResults=False,
    RemoteSolveVersion=(0, 1, 0),
    ShowInput_Enabled=False,
    ShowInput_Path=True,
    SynchronousSolve=True)
hops_12 = Hops(
    CacheResultsInMemory=False,
    CacheSolveResults=False,
    RemoteSolveVersion=(0, 1, 0),
    ShowInput_Enabled=False,
    ShowInput_Path=True,
    SynchronousSolve=True)
nurbs_curve_pwk = NurbsCurvePWK()  # -> Curve, Length, Domain
hops_13 = Hops(
    CacheResultsInMemory=False,
    CacheSolveResults=False,
    RemoteSolveVersion=(0, 1, 0),
    ShowInput_Enabled=False,
    ShowInput_Path=True,
    SynchronousSolve=True)
hops_14 = Hops(
    CacheResultsInMemory=False,
    CacheSolveResults=False,
    RemoteSolveVersion=(0, 1, 0),
    ShowInput_Enabled=False,
    ShowInput_Path=True,
    SynchronousSolve=True)
hops_15 = Hops(
    CacheResultsInMemory=False,
    CacheSolveResults=False,
    RemoteSolveVersion=(0, 1, 0),
    ShowInput_Enabled=False,
    ShowInput_Path=True,
    SynchronousSolve=True)
hops_16 = Hops(
    CacheResultsInMemory=False,
    CacheSolveResults=False,
    RemoteSolveVersion=(0, 1, 0),
    ShowInput_Enabled=False,
    ShowInput_Path=True,
    SynchronousSolve=True)
hops_17 = Hops(
    CacheResultsInMemory=False,
    CacheSolveResults=False,
    RemoteSolveVersion=(0, 1, 0),
    ShowInput_Enabled=False,
    ShowInput_Path=True,
    SynchronousSolve=True)
hops_18 = Hops(
    CacheResultsInMemory=False,
    CacheSolveResults=False,
    RemoteSolveVersion=(0, 1, 0),
    ShowInput_Enabled=False,
    ShowInput_Path=True,
    SynchronousSolve=True)
connect_curves = ConnectCurves(Continuity=2, Close=True, Bulge=1)
